# Grasshopper definition groundtrack_example.gh (Grasshopper 1.0.8)
# plug-ins: groundtrack

# ---- group: 6 Ramps between levels: the plaza, and plaza 3 30 m north and 5 m up (Transform Field), joined by two drawn ramps (Ramps curves -> Field from Curves) and merged into one continuous field (Merge Fields)
ramps = Curve([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])
site = ValueList({"trafalgar_square", "tottenham_court_road", "reuters_plaza", "blackwall_motorway"}, selected="reuters_plaza")
clip = ValueList({"whole", "plaza1", "plaza2", "plaza3"}, selected="whole")
group = ValueList({"people"}, selected="people")
field = Field(Site=site, Clip=clip, Group=group, Window=5, Heights=True)  # -> Field, Points, Vectors, Speed, Density, Colour, Info
site_2 = ValueList({"trafalgar_square", "tottenham_court_road", "reuters_plaza", "blackwall_motorway"}, selected="reuters_plaza")
clip_2 = ValueList({"whole", "plaza1", "plaza2", "plaza3"}, selected="plaza3")
group_2 = ValueList({"people"}, selected="people")
field_2 = Field(Site=site_2, Clip=clip_2, Group=group_2, Window=5, Heights=True)  # -> Field, Points, Vectors, Speed, Density, Colour, Info
xfield = TransformField(Field=field.Field, Move=Vector(560, 0, 0), Rotate=0, Scale=1, StretchX=1, StretchY=1, Mirror=False)  # -> Field, Transform
xfield_2 = TransformField(Field=field_2.Field, Move=Vector(560, 123.5, 5), Rotate=0, Scale=1, StretchX=1, StretchY=1, Mirror=False)  # -> Field, Transform
crvfield = FieldFromCurves(Curves=ramps, Speed=1.3, Width=3)
merge = MergeFields(Fields=[xfield.Field, xfield_2.Field, crvfield], Feather=4, Smooth=1.5, Fill=True, MaxSlope=1)
stream = Streamlines(Field=merge, Density=0.5, MinConfidence=0.05, Width=1.5)  # -> Curves, Speed, Colour, Spacing
time = Timeline(FPS=30, Window=False, gt_current=0, gt_fps=30, gt_in=0, gt_loop=True, gt_out=30, gt_scale=2, gt_speed=1)  # -> T, Frame, Playing
pop = Particles(
    Fields=merge,
    Time=time.T,
    Run=False,
    Reset=False,
    Rate=300,
    Speed=1,
    Noise=0,
    Trail=2,
    Seed=1,
    Response=0,
    Hold=1,
    Drag=1,
    Outside=False,
    Colour="speed",
    Join=2,
    Width=1.5)  # -> Points, Velocity, Speed, Colour, Trails, Age, Time, Layer

# ---- group: 1 Field -> Streamlines: pick site / clip / group
site_3 = ValueList({"trafalgar_square", "tottenham_court_road", "reuters_plaza", "blackwall_motorway"}, selected="reuters_plaza")
clip_3 = ValueList({"whole", "plaza1", "plaza2", "plaza3"}, selected="whole")
group_3 = ValueList({"people"}, selected="people")
field_3 = Field(Site=site_3, Clip=clip_3, Group=group_3, Window=5, Heights=True)  # -> Field, Points, Vectors, Speed, Density, Colour, Info
stream_2 = Streamlines(Field=field_3.Field, Density=0.5, MinConfidence=0.05, Width=1.5)  # -> Curves, Speed, Colour, Spacing

# ---- group: 2 Particles + Replay on a Timeline (moved 70 m east): double-click the Timeline to play / scrub / record
site_4 = ValueList({"trafalgar_square", "tottenham_court_road", "reuters_plaza", "blackwall_motorway"}, selected="reuters_plaza")
clip_4 = ValueList({"whole", "plaza1", "plaza2", "plaza3"}, selected="plaza1")
group_4 = ValueList({"people"}, selected="people")
field_4 = Field(Site=site_4, Clip=clip_4, Group=group_4, Window=5, Heights=True)  # -> Field, Points, Vectors, Speed, Density, Colour, Info
move = Move(Geometry=field_4.Field, Translation=Vector(70, 0, 0))
time_2 = Timeline(FPS=30, Window=False, gt_current=0, gt_fps=30, gt_in=0, gt_loop=True, gt_out=30, gt_scale=2, gt_speed=1)  # -> T, Frame, Playing
pop_2 = Particles(
    Fields=move,
    Time=time_2.T,
    Run=False,
    Reset=False,
    Rate=300,
    Speed=1,
    Noise=0,
    Trail=2,
    Seed=1,
    Response=0,
    Hold=1,
    Drag=1,
    Outside=False,
    Colour="speed",
    Join=2,
    Width=1.5)  # -> Points, Velocity, Speed, Colour, Trails, Age, Time, Layer
replay = Replay(Field=move, Time=time_2.T, Tail=3, Width=1.5)  # -> Points, Velocity, Speed, Colour, Trails, Id, Range

# ---- group: 3 Two clips: Blend (T slider) and where their flows cross (heat map), 140 m east
site_5 = ValueList({"trafalgar_square", "tottenham_court_road", "reuters_plaza", "blackwall_motorway"}, selected="reuters_plaza")
clip_5 = ValueList({"whole", "plaza1", "plaza2", "plaza3"}, selected="plaza1")
group_5 = ValueList({"people"}, selected="people")
field_5 = Field(Site=site_5, Clip=clip_5, Group=group_5, Window=5, Heights=True)  # -> Field, Points, Vectors, Speed, Density, Colour, Info
site_6 = ValueList({"trafalgar_square", "tottenham_court_road", "reuters_plaza", "blackwall_motorway"}, selected="reuters_plaza")
clip_6 = ValueList({"whole", "plaza1", "plaza2", "plaza3"}, selected="plaza3")
group_6 = ValueList({"people"}, selected="people")
field_6 = Field(Site=site_6, Clip=clip_6, Group=group_6, Window=5, Heights=True)  # -> Field, Points, Vectors, Speed, Density, Colour, Info
move_2 = Move(Geometry=field_5.Field, Translation=Vector(140, 0, 0))
move_3 = Move(Geometry=field_6.Field, Translation=Vector(140, 0, 0))
blend = BlendFields(Fields=[move_2, move_3], T=0.5, Feather=4, Smooth=1.5, Fill=False, MaxSlope=1)  # -> Field, Weights
stream_3 = Streamlines(Field=move_2, Density=0.5, MinConfidence=0.05, Width=1.5)  # -> Curves, Speed, Colour, Spacing
stream_4 = Streamlines(Field=move_3, Density=0.5, MinConfidence=0.05, Width=1.5)  # -> Curves, Speed, Colour, Spacing
cross = Crossings(A=stream_3.Curves, B=stream_4.Curves, Width=1.5)  # -> Points, Angle, AIndex, BIndex, Count, Heat

# ---- group: 4 Layers + forces: two fields stacked 8 m apart (Transform Field), pulling on each other (Interact) and swirling (Axis Force)
site_7 = ValueList({"trafalgar_square", "tottenham_court_road", "reuters_plaza", "blackwall_motorway"}, selected="reuters_plaza")
clip_7 = ValueList({"whole", "plaza1", "plaza2", "plaza3"}, selected="whole")
group_7 = ValueList({"people"}, selected="people")
field_7 = Field(Site=site_7, Clip=clip_7, Group=group_7, Window=5, Heights=True)  # -> Field, Points, Vectors, Speed, Density, Colour, Info
site_8 = ValueList({"trafalgar_square", "tottenham_court_road", "reuters_plaza", "blackwall_motorway"}, selected="reuters_plaza")
clip_8 = ValueList({"whole", "plaza1", "plaza2", "plaza3"}, selected="plaza3")
group_8 = ValueList({"people"}, selected="people")
field_8 = Field(Site=site_8, Clip=clip_8, Group=group_8, Window=5, Heights=True)  # -> Field, Points, Vectors, Speed, Density, Colour, Info
xfield_3 = TransformField(Field=field_7.Field, Move=Vector(210, 0, 0), Rotate=0, Scale=1, StretchX=1, StretchY=1, Mirror=False)  # -> Field, Transform
xfield_4 = TransformField(Field=field_8.Field, Move=Vector(210, 0, 8), Rotate=0, Scale=1, StretchX=1, StretchY=1, Mirror=False)  # -> Field, Transform
interact = Interact(Between="others", Radius=10, Separation=1, Cohesion=1.5, Alignment=0.5)
axis = AxisForce(Axis=Line((211, 0.75, 0), (211, 0.75, 10)), Radius=20, Orbit=1, Suction=0, Lift=0)
time_3 = Timeline(FPS=30, Window=False, gt_current=0, gt_fps=30, gt_in=0, gt_loop=True, gt_out=30, gt_scale=2, gt_speed=1)  # -> T, Frame, Playing
pop_3 = Particles(
    Fields=[xfield_3.Field, xfield_4.Field],
    Time=time_3.T,
    Run=False,
    Reset=False,
    Rate=200,
    Speed=1,
    Noise=0,
    Trail=2,
    Seed=1,
    Forces=[interact, axis],
    Response=0,
    Hold=0.2,
    Drag=1,
    Outside=False,
    Colour="layer",
    Join=2,
    Width=1.5)  # -> Points, Velocity, Speed, Colour, Trails, Age, Time, Layer

# ---- group: 5 Tilted: the plaza stood up on its south edge with Grasshopper's Rotate 3D (90 deg about X); streamlines and particles run up the wall
site_9 = ValueList({"trafalgar_square", "tottenham_court_road", "reuters_plaza", "blackwall_motorway"}, selected="reuters_plaza")
clip_9 = ValueList({"whole", "plaza1", "plaza2", "plaza3"}, selected="whole")
group_9 = ValueList({"people"}, selected="people")
field_9 = Field(Site=site_9, Clip=clip_9, Group=group_9, Window=5, Heights=True)  # -> Field, Points, Vectors, Speed, Density, Colour, Info
rot3d = Rotate3D(Geometry=field_9.Field, Angle=1.570796327, Center=Point(0, -46, 0), Axis=Vector(1, 0, 0))  # -> Geometry, Transform
move_4 = Move(Geometry=rot3d.Geometry, Translation=Vector(420, 0, 0))
stream_5 = Streamlines(Field=move_4, Density=0.5, MinConfidence=0.05, Width=1.5)  # -> Curves, Speed, Colour, Spacing
time_4 = Timeline(FPS=30, Window=False, gt_current=0, gt_fps=30, gt_in=0, gt_loop=True, gt_out=30, gt_scale=2, gt_speed=1)  # -> T, Frame, Playing
pop_4 = Particles(
    Fields=move_4,
    Time=time_4.T,
    Run=False,
    Reset=False,
    Rate=300,
    Speed=1,
    Noise=0,
    Trail=2,
    Seed=1,
    Response=0,
    Hold=1,
    Drag=1,
    Outside=False,
    Colour="speed",
    Join=2,
    Width=1.5)  # -> Points, Velocity, Speed, Colour, Trails, Age, Time, Layer

# ---- group: 7 Folded surface: a motorway clip (Smooth Field: holes closed) three times, hinged edge to edge - floor, 30 deg slope, wall (Move + Rotate 3D about the shared edges); vehicles carry on from one onto the next (Particles: Join 8 m)
site_10 = ValueList({"trafalgar_square", "tottenham_court_road", "reuters_plaza", "blackwall_motorway"}, selected="blackwall_motorway")
clip_10 = ValueList({"whole", "motorway2", "motorway3", "motorway4", "motorway5", "motorway6"}, selected="motorway5")
group_10 = ValueList({"vehicles"}, selected="vehicles")
field_10 = Field(Site=site_10, Clip=clip_10, Group=group_10, Window=5, Heights=True)  # -> Field, Points, Vectors, Speed, Density, Colour, Info
smooth = SmoothField(Field=field_10.Field, Radius=4, Fill=True, MaxSlope=0)
move_5 = Move(Geometry=smooth, Motion=Vector(700, 0, 0))  # -> Geometry, Transform
move_6 = Move(Geometry=smooth, Motion=Vector(730.0191254, -211.4371076, 0))  # -> Geometry, Transform
rot3d_2 = Rotate3D(
    Geometry=move_6.Geometry,
    Angle=0.5235987756,
    Center=Point(723.719763, -167.0680944, 0),
    Axis=Vector(-0.9900711745, -0.1405669568, 0))  # -> Geometry, Transform
move_7 = Move(Geometry=smooth, Motion=Vector(760.0382509, -422.8742152, 0))  # -> Geometry, Transform
rot3d_3 = Rotate3D(
    Geometry=move_7.Geometry,
    Angle=0.5235987756,
    Center=Point(723.719763, -167.0680944, 0),
    Axis=Vector(-0.9900711745, -0.1405669568, 0))  # -> Geometry, Transform
rot3d_4 = Rotate3D(
    Geometry=rot3d_3.Geometry,
    Angle=1.047197551,
    Center=Point(749.7170882, -350.1780009, 106.7787413),
    Axis=Vector(-0.9900711745, -0.1405669568, 0))  # -> Geometry, Transform
stream_6 = Streamlines(Field=[move_5.Geometry, rot3d_2.Geometry, rot3d_4.Geometry], Density=0.5, MinConfidence=0.05, Width=1.5)  # -> Curves, Speed, Colour, Spacing
time_5 = Timeline(FPS=30, Window=False, gt_current=0, gt_fps=30, gt_in=0, gt_loop=True, gt_out=30, gt_scale=2, gt_speed=1)  # -> T, Frame, Playing
pop_5 = Particles(
    Fields=[move_5.Geometry, rot3d_2.Geometry, rot3d_4.Geometry],
    Time=time_5.T,
    Run=False,
    Reset=False,
    Rate=300,
    Speed=1,
    Noise=0,
    Trail=2,
    Seed=1,
    Response=0,
    Hold=1,
    Drag=1,
    Outside=False,
    Colour="layer",
    Join=8,
    Width=1.5)  # -> Points, Velocity, Speed, Colour, Trails, Age, Time, Layer

# ---- group: 8 Lofted landscape: three plaza layers stacked 8 m apart (Transform Field), the top one waving (Warp Field), joined at their edges by rounded folds (Loft Fields): streamlines, particles and surfaces over all of it
site_11 = ValueList({"trafalgar_square", "tottenham_court_road", "reuters_plaza", "blackwall_motorway"}, selected="reuters_plaza")
clip_11 = ValueList({"whole", "plaza1", "plaza2", "plaza3"}, selected="whole")
group_11 = ValueList({"people"}, selected="people")
field_11 = Field(Site=site_11, Clip=clip_11, Group=group_11, Window=5, Heights=True)  # -> Field, Points, Vectors, Speed, Density, Colour, Info
xfield_5 = TransformField(Field=field_11.Field, Move=Vector(900, 0, 16), Rotate=0, Scale=1, StretchX=1, StretchY=1, Mirror=False)  # -> Field, Transform
site_12 = ValueList({"trafalgar_square", "tottenham_court_road", "reuters_plaza", "blackwall_motorway"}, selected="reuters_plaza")
clip_12 = ValueList({"whole", "plaza1", "plaza2", "plaza3"}, selected="plaza3")
group_12 = ValueList({"people"}, selected="people")
field_12 = Field(Site=site_12, Clip=clip_12, Group=group_12, Window=5, Heights=True)  # -> Field, Points, Vectors, Speed, Density, Colour, Info
xfield_6 = TransformField(Field=field_12.Field, Move=Vector(900, 0, 8), Rotate=0, Scale=1, StretchX=1, StretchY=1, Mirror=False)  # -> Field, Transform
site_13 = ValueList({"trafalgar_square", "tottenham_court_road", "reuters_plaza", "blackwall_motorway"}, selected="reuters_plaza")
clip_13 = ValueList({"whole", "plaza1", "plaza2", "plaza3"}, selected="plaza1")
group_13 = ValueList({"people"}, selected="people")
field_13 = Field(Site=site_13, Clip=clip_13, Group=group_13, Window=5, Heights=True)  # -> Field, Points, Vectors, Speed, Density, Colour, Info
xfield_7 = TransformField(Field=field_13.Field, Move=Vector(900, 0, 0), Rotate=0, Scale=1, StretchX=1, StretchY=1, Mirror=False)  # -> Field, Transform
warp = WarpField(Field=xfield_5.Field, Mode="wave")
loft = LoftFields(Fields=[warp, xfield_6.Field, xfield_7.Field], Start=0, End=1, Swing=1)  # -> Folds, All
stream_7 = Streamlines(Field=loft.All, Density=0.5, MinConfidence=0.05, Width=1.5)  # -> Curves, Speed, Colour, Spacing
time_6 = Timeline(FPS=30, Window=False, gt_current=0, gt_fps=30, gt_in=0, gt_loop=True, gt_out=30, gt_scale=2, gt_speed=1)  # -> T, Frame, Playing
pop_6 = Particles(
    Fields=loft.All,
    Time=time_6.T,
    Run=False,
    Reset=False,
    Rate=300,
    Speed=1,
    Noise=0,
    Trail=2,
    Seed=1,
    Response=0,
    Hold=1,
    Drag=1,
    Outside=False,
    Colour="speed",
    Join=2,
    Width=1.5)  # -> Points, Velocity, Speed, Colour, Trails, Age, Time, Layer
surf = FieldSurface(Field=loft.All, Width=1.5)  # -> Mesh, Outlines

# ---- group: 9 Bend, bridge, cut: plaza 3 bent up 60 deg (Warp Field) and joined to the plaza by automatic ribbons (Bridge); a copy tilted 35 deg cuts the plaza (Intersect Fields)
site_14 = ValueList({"trafalgar_square", "tottenham_court_road", "reuters_plaza", "blackwall_motorway"}, selected="reuters_plaza")
clip_14 = ValueList({"whole", "plaza1", "plaza2", "plaza3"}, selected="whole")
group_14 = ValueList({"people"}, selected="people")
field_14 = Field(Site=site_14, Clip=clip_14, Group=group_14, Window=5, Heights=True)  # -> Field, Points, Vectors, Speed, Density, Colour, Info
site_15 = ValueList({"trafalgar_square", "tottenham_court_road", "reuters_plaza", "blackwall_motorway"}, selected="reuters_plaza")
clip_15 = ValueList({"whole", "plaza1", "plaza2", "plaza3"}, selected="plaza3")
group_15 = ValueList({"people"}, selected="people")
field_15 = Field(Site=site_15, Clip=clip_15, Group=group_15, Window=5, Heights=True)  # -> Field, Points, Vectors, Speed, Density, Colour, Info
xfield_8 = TransformField(Field=field_14.Field, Move=Vector(1100, 0, 0), Rotate=0, Scale=1, StretchX=1, StretchY=1, Mirror=False)  # -> Field, Transform
xfield_9 = TransformField(Field=field_15.Field, Move=Vector(1100, 135, 6), Rotate=0, Scale=1, StretchX=1, StretchY=1, Mirror=False)  # -> Field, Transform
warp_2 = WarpField(Field=xfield_9.Field, Mode="bend", Amount=60)
bridge = Bridge(Fields=[xfield_8.Field, warp_2], Count=2, Width=4, Swing=1, Reach=120, Speed=1.3)  # -> Bridges, Curves, All
stream_8 = Streamlines(Field=bridge.All, Density=0.5, MinConfidence=0.05, Width=1.5)  # -> Curves, Speed, Colour, Spacing
time_7 = Timeline(FPS=30, Window=False, gt_current=0, gt_fps=30, gt_in=0, gt_loop=True, gt_out=30, gt_scale=2, gt_speed=1)  # -> T, Frame, Playing
pop_7 = Particles(
    Fields=bridge.All,
    Time=time_7.T,
    Run=False,
    Reset=False,
    Rate=300,
    Speed=1,
    Noise=0,
    Trail=2,
    Seed=1,
    Response=0,
    Hold=1,
    Drag=1,
    Outside=False,
    Colour="speed",
    Join=2,
    Width=1.5)  # -> Points, Velocity, Speed, Colour, Trails, Age, Time, Layer
rot3d_5 = Rotate3D(Geometry=xfield_8.Field, Angle=0.6108652382, Center=Point(1101, 0.75, 0), Axis=Vector(1, 0, 0))  # -> Geometry, Transform
cut = IntersectFields(Fields=[xfield_8.Field, rot3d_5.Geometry])  # -> Curves, Angle, Pair
stream_9 = Streamlines(Field=rot3d_5.Geometry, Density=0.5, MinConfidence=0.05, Width=1.5)  # -> Curves, Speed, Colour, Spacing

# ---- group: 10 Fuse + sculpt + Houdini: a hollow pressed into the plaza (Sculpt Field, the flow running down into it), fused with plaza 3 beside it where they come close (Fuse Fields); Houdini Export: set Export to true, paste the Houdini line
site_16 = ValueList({"trafalgar_square", "tottenham_court_road", "reuters_plaza", "blackwall_motorway"}, selected="reuters_plaza")
clip_16 = ValueList({"whole", "plaza1", "plaza2", "plaza3"}, selected="whole")
group_16 = ValueList({"people"}, selected="people")
field_16 = Field(Site=site_16, Clip=clip_16, Group=group_16, Window=5, Heights=True)  # -> Field, Points, Vectors, Speed, Density, Colour, Info
site_17 = ValueList({"trafalgar_square", "tottenham_court_road", "reuters_plaza", "blackwall_motorway"}, selected="reuters_plaza")
clip_17 = ValueList({"whole", "plaza1", "plaza2", "plaza3"}, selected="plaza3")
group_17 = ValueList({"people"}, selected="people")
field_17 = Field(Site=site_17, Clip=clip_17, Group=group_17, Window=5, Heights=True)  # -> Field, Points, Vectors, Speed, Density, Colour, Info
xfield_10 = TransformField(Field=field_16.Field, Move=Vector(1300, 0, 0), Rotate=0, Scale=1, StretchX=1, StretchY=1, Mirror=False)  # -> Field, Transform
xfield_11 = TransformField(Field=field_17.Field, Move=Vector(1340, 0, 4), Rotate=0, Scale=1, StretchX=1, StretchY=1, Mirror=False)  # -> Field, Transform
sculpt = SculptField(Field=xfield_10.Field, Points=Point(1301, 0.75, 0), Height=-5, Falloff=8, Radius=18, Width=6, Downhill=1)
fuse = FuseFields(Fields=[sculpt, xfield_11.Field], Reach=16, Swing=0.6)  # -> Fusions, All
stream_10 = Streamlines(Field=fuse.All, Density=0.5, MinConfidence=0.05, Width=1.5)  # -> Curves, Speed, Colour, Spacing
time_8 = Timeline(FPS=30, Window=False, gt_current=0, gt_fps=30, gt_in=0, gt_loop=True, gt_out=30, gt_scale=2, gt_speed=1)  # -> T, Frame, Playing
pop_8 = Particles(
    Fields=fuse.All,
    Time=time_8.T,
    Run=False,
    Reset=False,
    Rate=300,
    Speed=1,
    Noise=0,
    Trail=2,
    Seed=1,
    Response=0,
    Hold=1,
    Drag=1,
    Outside=False,
    Colour="speed",
    Join=2,
    Width=1.5)  # -> Points, Velocity, Speed, Colour, Trails, Age, Time, Layer
houdini = HoudiniExport(Fields=fuse.All, Name="plaza_fused", Mode="force", AirResistance=1, Export=False)  # -> Folder, Houdini, Files
