# Grasshopper definition example_0.2.0.gh (Grasshopper 1.0.8)
# plug-ins: groundtrack

# ---- group: 1 Field -> Streamlines: pick site / clip / group
site = ValueList({"trafalgar_square", "tottenham_court_road", "reuters_plaza", "blackwall_motorway"}, selected="reuters_plaza")
clip = ValueList({"whole", "plaza1", "plaza2", "plaza3"}, selected="whole")
group = ValueList({"people"}, selected="people")
field = Field(Site=site, Clip=clip, Group=group, Window=5, Heights=True)  # -> Field, Points, Vectors, Speed, Density, Colour, Info
stream = Streamlines(Field=field.Field, Density=0.5, MinConfidence=0.05)  # -> Curves, Speed, Colour, Spacing

# ---- group: 2 Particles + Replay on a Timeline (moved 70 m east): double-click the Timeline to play / scrub / record
site_2 = ValueList({"trafalgar_square", "tottenham_court_road", "reuters_plaza", "blackwall_motorway"}, selected="reuters_plaza")
clip_2 = ValueList({"whole", "plaza1", "plaza2", "plaza3"}, selected="plaza1")
group_2 = ValueList({"people"}, selected="people")
field_2 = Field(Site=site_2, Clip=clip_2, Group=group_2, Window=5, Heights=True)  # -> Field, Points, Vectors, Speed, Density, Colour, Info
move = Move(Geometry=field_2.Field, Translation=Vector(70, 0, 0))
time = Timeline(FPS=30, Window=False, gt_current=0, gt_fps=30, gt_in=0, gt_loop=True, gt_out=30, gt_speed=1)  # -> T, Frame, Playing
pop = Particles(
    Fields=move,
    Time=time.T,
    Run=False,
    Reset=False,
    Rate=300,
    Speed=1,
    Noise=0,
    Trail=2,
    Seed=1,
    Response=0,
    Hold=1,
    Drag=1,
    Outside=False,
    Colour="speed")  # -> Points, Velocity, Speed, Colour, Trails, Age, Time, Layer
replay = Replay(Field=move, Time=time.T, Tail=3)  # -> Points, Velocity, Speed, Colour, Trails, Id, Range

# ---- group: 3 Two clips: Blend (T slider) and where their flows cross (heat map), 140 m east
site_3 = ValueList({"trafalgar_square", "tottenham_court_road", "reuters_plaza", "blackwall_motorway"}, selected="reuters_plaza")
clip_3 = ValueList({"whole", "plaza1", "plaza2", "plaza3"}, selected="plaza1")
group_3 = ValueList({"people"}, selected="people")
field_3 = Field(Site=site_3, Clip=clip_3, Group=group_3, Window=5, Heights=True)  # -> Field, Points, Vectors, Speed, Density, Colour, Info
site_4 = ValueList({"trafalgar_square", "tottenham_court_road", "reuters_plaza", "blackwall_motorway"}, selected="reuters_plaza")
clip_4 = ValueList({"whole", "plaza1", "plaza2", "plaza3"}, selected="plaza3")
group_4 = ValueList({"people"}, selected="people")
field_4 = Field(Site=site_4, Clip=clip_4, Group=group_4, Window=5, Heights=True)  # -> Field, Points, Vectors, Speed, Density, Colour, Info
move_2 = Move(Geometry=field_3.Field, Translation=Vector(140, 0, 0))
move_3 = Move(Geometry=field_4.Field, Translation=Vector(140, 0, 0))
blend = BlendFields(Fields=[move_2, move_3], T=0.5, Feather=4, Smooth=1.5, Fill=False, MaxSlope=1)  # -> Field, Weights
stream_2 = Streamlines(Field=move_2, Density=0.5, MinConfidence=0.05)  # -> Curves, Speed, Colour, Spacing
stream_3 = Streamlines(Field=move_3, Density=0.5, MinConfidence=0.05)  # -> Curves, Speed, Colour, Spacing
cross = Crossings(A=stream_2.Curves, B=stream_3.Curves)  # -> Points, Angle, AIndex, BIndex, Count, Heat

# ---- group: 4 Layers + forces: two fields stacked 8 m apart (Transform Field), pulling on each other (Interact) and swirling (Axis Force)
site_5 = ValueList({"trafalgar_square", "tottenham_court_road", "reuters_plaza", "blackwall_motorway"}, selected="reuters_plaza")
clip_5 = ValueList({"whole", "plaza1", "plaza2", "plaza3"}, selected="whole")
group_5 = ValueList({"people"}, selected="people")
field_5 = Field(Site=site_5, Clip=clip_5, Group=group_5, Window=5, Heights=True)  # -> Field, Points, Vectors, Speed, Density, Colour, Info
site_6 = ValueList({"trafalgar_square", "tottenham_court_road", "reuters_plaza", "blackwall_motorway"}, selected="reuters_plaza")
clip_6 = ValueList({"whole", "plaza1", "plaza2", "plaza3"}, selected="plaza3")
group_6 = ValueList({"people"}, selected="people")
field_6 = Field(Site=site_6, Clip=clip_6, Group=group_6, Window=5, Heights=True)  # -> Field, Points, Vectors, Speed, Density, Colour, Info
xfield = TransformField(Field=field_5.Field, Move=Vector(210, 0, 0), Rotate=0, Scale=1, StretchX=1, StretchY=1, Mirror=False)  # -> Field, Transform
xfield_2 = TransformField(Field=field_6.Field, Move=Vector(210, 0, 8), Rotate=0, Scale=1, StretchX=1, StretchY=1, Mirror=False)  # -> Field, Transform
interact = Interact(Between="others", Radius=10, Separation=1, Cohesion=1.5, Alignment=0.5)
axis = AxisForce(Axis=Line((211, 0.75, 0), (211, 0.75, 10)), Radius=20, Orbit=1, Suction=0, Lift=0)
time_2 = Timeline(FPS=30, Window=False, gt_current=0, gt_fps=30, gt_in=0, gt_loop=True, gt_out=30, gt_speed=1)  # -> T, Frame, Playing
pop_2 = Particles(
    Fields=[xfield.Field, xfield_2.Field],
    Time=time_2.T,
    Run=False,
    Reset=False,
    Rate=200,
    Speed=1,
    Noise=0,
    Trail=2,
    Seed=1,
    Forces=[interact, axis],
    Response=0,
    Hold=0.2,
    Drag=1,
    Outside=False,
    Colour="layer")  # -> Points, Velocity, Speed, Colour, Trails, Age, Time, Layer

# ---- group: 5 Tilted: the plaza stood up on its south edge with Grasshopper's Rotate 3D (90 deg about X); streamlines and particles run up the wall
site_7 = ValueList({"trafalgar_square", "tottenham_court_road", "reuters_plaza", "blackwall_motorway"}, selected="reuters_plaza")
clip_7 = ValueList({"whole", "plaza1", "plaza2", "plaza3"}, selected="whole")
group_7 = ValueList({"people"}, selected="people")
field_7 = Field(Site=site_7, Clip=clip_7, Group=group_7, Window=5, Heights=True)  # -> Field, Points, Vectors, Speed, Density, Colour, Info
rot3d = Rotate3D(Geometry=field_7.Field, Angle=1.570796327, Center=Point(0, -46, 0), Axis=Vector(1, 0, 0))  # -> Geometry, Transform
move_4 = Move(Geometry=rot3d.Geometry, Translation=Vector(420, 0, 0))
stream_4 = Streamlines(Field=move_4, Density=0.5, MinConfidence=0.05)  # -> Curves, Speed, Colour, Spacing
time_3 = Timeline(FPS=30, Window=False, gt_current=0, gt_fps=30, gt_in=0, gt_loop=True, gt_out=30, gt_speed=1)  # -> T, Frame, Playing
pop_3 = Particles(
    Fields=move_4,
    Time=time_3.T,
    Run=False,
    Reset=False,
    Rate=300,
    Speed=1,
    Noise=0,
    Trail=2,
    Seed=1,
    Response=0,
    Hold=1,
    Drag=1,
    Outside=False,
    Colour="speed")  # -> Points, Velocity, Speed, Colour, Trails, Age, Time, Layer
